# Grasshopper definition evaluating_surfaces.gh (Grasshopper 1.0.7)

surface = Surface(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)
python = GhPythonScript(surface=surface, uDiv=Slider(2, range=2..10), vDiv=Slider(10, range=2..10))  # -> out, points; inputs surface: Surface, uDiv: Int32, vDiv: Int32
# ---------- python: Python ----------
import Rhino.Geometry as rg

points = []

## Define the domain
domain = rg.Interval(0,1)
surface.SetDomain(0, domain)
surface.SetDomain(1, domain)

for u in range(uDiv+1):
    for v in range(vDiv+1):
        point = surface.PointAt(u/uDiv, v/vDiv)
        points.append(point)
# ---------- end python ----------
